vi "Main Window.gvi"   [LabVIEW NXG 5.0.0]
panel controls:
  "Main Tab": i32
  "Light Calibration Tab": i32
  "Start Wavelength (nm)": f64 = 300
  "End Wavelength (nm)": f64 = 900
  "Wavelength Step (nm)": f64 = 5
  "New Spectrum Calibration": bool
  "Load Spectrum Calibration": bool
  "Save Spectrum Calibration": bool
  "Initialize App Bundle Cluster": "Initialize App Bundle Cluster.gtype"
  "Configuration Tab": i32
  "Abort Button": bool
  "Exit App Button": bool
  "Debugging Cluster": "Debugging Cluster.gtype"
  "Rainbow Measurement tab": i32
  "Instrument Coms Info": "Instrument Coms Info.gtype"
  "Rainbow Sweep Param Selector": "Rainbow Sweep Param Selector.gtype" = {0, 1100, 300, 1, 1, 0}
  "Check Dividing Wavelength Calibration": bool
  "New Dividing Wavelength Calibration": bool
  "Load Dividing Wavelength Calibration": bool
  "Measuring Spot Sperctrum Calibration Parameters": "MSpot Spectrum Calibration Parameters.gtype" = {"Min Position (mm)"=0, "Max Position (mm)"=10, "Position step size (mm)"=0.1, "Manual Spectra?"=FALSE}
  "New Light Power Calibration": bool
  "Load Light Power Calibration": bool
  "Save Light Power Calibration": bool
  "Rainbow Sweep Parameters LPC": "Rainbow Sweep Param Selector.gtype" = {0, 1100, 300, 1, 1, 0}
  "Default Data Saving Location": path = path "C:\\Users\\minus\\Documents\\LabVIEW Projects\\Rainbow_NXG\\File tests"
  "Light Power Calibration Data": "Light Power Calibration Data.gtype"[]
  "Cell Naming Cluster": "Cell Naming Cluster.gtype"
  "Custom date": bool
  "Author Initials": string
  "Batch Name": string
  "Cell Number": string
  "Sample Comments": string
  "Current Date": string
  "Acquire Sngle Rainbow Button": bool
  "Load Single Measurement": bool
  "Save Single Measurement": bool
  "Rainbow Sweep Parameters RSM": "Rainbow Sweep Param Selector.gtype" = {0, 1100, 300, 1, 1, 0}
  "LPC Parameters": "Light power Calibration Parameters.gtype" = {"Powermeter Averages"=3}
panel indicators:
  "Irradiance Calibration": f64[]
  "Light Power (W)": f64
  "Current Wavelength (nm)": f64
  "Current State": "Queue Instructions Control.gtype"
  "Current Sub State": string
  "Beam Power Density": f64[][]
  "Path Where the Calibration Files Will Be Stored (Can't Be Changed)": path
  "Desired MSpot Calibration Operation": "Calibration Operation Control.gtype"
  "Light Power Calibration": cluster{"Element 1": f64[], "Element 2": f64[]}[]
  "Sweep Live Parameters LPC": "LPC Sweep Live Parameters.gtype"
  "Sample Prefix": string
  "Progress %": f64
  "Progress counter": f64
  "State": string
  "Substate": string
  "Label Info Error Label": string
  "Label Info Missing Error": bool
  "Light Power Operation Control": "Light Power Operation Control.gtype"
  "Light Power Calibration_2": cluster{"Element 1": f64[], "Element 2": f64[]}[]
  "Sweep Live Parameters RSM": "LPC Sweep Live Parameters.gtype"
types:
  "All Paths Cluster.gtype" = cluster{"Thorlabs Motor Serial Number File Path": path}
  "Instrument Coms Info.gtype" = cluster{"Arduino Coms Info": "Arduino Detection cluster control.gtype", "Photodetector Names": string[], "Keythley Address": "VISA Instr", "Photodetector Detected?": bool, "Thorlabs Motors Detected?": bool, "Keithley Detected?": bool, "Thorlabs Motors Serial Number": "Thorlabs Motors Serial Number In.gtype", "Photodetector IVI session": "Ivi IviDefault"}
  "Initialize App Bundle Cluster.gtype" = cluster{"All Paths": "All Paths Cluster.gtype", "Instrument Coms Info": "Instrument Coms Info.gtype"}
  "Queue Instructions Control.gtype" = enum{"Undefined State", "Debug Check", "Initialize App", "Idle", "Light Power Calibration", "Rainbow Single Measurement", "Light Calibration Irradiance", "Light Calibration Spectral Density", "Light Calibration Power Density", "MSpot Spectrum Calibration", "Access TXT File", "Stop App"}
  "Insturment Debugging Cluster.gtype" = cluster{"Keithley": bool, "Arduinos": bool, "Thorlabs Motors": bool, "Photodetector": bool}
  "Debugging Cluster.gtype" = cluster{"Debugging mode?": bool, "Initialize App": bool, "Insturment Debugging": "Insturment Debugging Cluster.gtype"}
  "Raibow Sweep Selector.gtype" = enum{"Red Sweep", "Blue Sweep", "Full Sweep Red First", "Full Sweep Blue First"}
  "Rainbow Sweep Type Selector.gtype" = cluster{"Red Sweep Mode": enum{"Red Sweep Closing", "Red Sweep Opening"}, "Blue Sweep Mode": enum{"Blue Sweep Opening", "Blue Sweep Closing"}}
  "Rainbow Sweep Param Selector.gtype" = cluster{"Raibow Sweep Selector": "Raibow Sweep Selector.gtype", "Max Wavelength (nm)": f64, "Min Wavelength (nm)": f64, "Wavelength Step (nm)": f64, "Rainbow Sweep Types": "Rainbow Sweep Type Selector.gtype"}
  "Calibration Operation Control.gtype" = enum{"Check Calibration", "Load Calibration", "New Calibration"}
  "MSpot Spectrum Calibration Parameters.gtype" = cluster{"Min Position (mm)": f64, "Max Position (mm)": f64, "Position step size (mm)": f64, "Manual Spectra?": bool}
  "Rainbow Sweep Types.gtype" = enum{"Red Sweep Closing", "Red Sweep Opening", "Blue Sweep Closing", "Blue Sweep Opening"}
  "LPC Sweep Live Parameters.gtype" = cluster{"Light Power (W) ": f64, "Current Wavelength (nm)": f64, "Rainbow Sweep Types": "Rainbow Sweep Types.gtype"}
  T1 = cluster{"Dividing Wavelength Array": f64[], "Measured Power Array": f64[]}
  "Light Power Calibration Data.gtype" = cluster{"Single Light Calibration": T1, "Rainbow Sweep Types": "Rainbow Sweep Types.gtype"}
  "Cell Naming Cluster.gtype" = cluster{"Cell Label": string, "Sample Prefix": string, "Author Initials": string, "Current Date": string, "Batch Name": string}
  "Light Power Operation Control.gtype" = enum{"Save Calibration", "Load Calibration", "New Calibration"}
  "Light power Calibration Parameters.gtype" = cluster{"Powermeter Averages": f64}
  "Sample Naming Cluster.gtype" = cluster{"Author Initials": string, "Batch Name": string, "Sample Comments": string, "Main Tab control": i32, "Rainbow Measurement tab": i32, "Cell Number": string, "Cell Number ref": "StringControl reference", "Custom date": bool, "Current Date": string, "Current Date ref": "StringControl reference"}
uses:
  Rainbow Measurement Setup::Side Functions::Global Abort::FGV Global Abort.gvi
  Rainbow Measurement Setup::Main Functions::Instruction Queue::Current State::FGV Current State.gvi
  Rainbow Measurement Setup::Main Functions::Debugging::Debugging Prompt.gvi
  Rainbow Measurement Setup::Main Functions::Initialize App::Initialize app subroutine.gvi
  Rainbow Measurement Setup::Side Functions::Utilities::Progress Handling::Progress FGV.gvi
  Rainbow Measurement Setup::Main Functions::One Time Calibrations::MSpot Spectrum::File Handling::MSpot Folder Check.gvi
  Rainbow Measurement Setup::Main Functions::One Time Calibrations::MSpot Spectrum::MSpot Spectrum Calibration Subroutine.gvi
  Rainbow Measurement Setup::Main Functions::Rainbow Measurement::Light Power Calibration::Light Power Calibration Subroutine.gvi
  NI::G Core::Error::Is Error.gvi
  Rainbow Measurement Setup::Main Functions::Rainbow Measurement::Light Power Calibration::Light Calibration Live Parameters FGV.gvi
  Rainbow Measurement Setup::Side Functions::Timeout Sequence.gvi
  Rainbow Measurement Setup::Side Functions::Exit App Sequence.gvi
  Rainbow Measurement Setup::Side Functions::Global Abort::Global Abort Sequence.gvi
  Rainbow Measurement Setup::Main Functions::Instruction Queue::Check Queue And Label.gvi
  Rainbow Measurement Setup::Main Functions::Instruction Queue::Conditional Enqueue.gvi
  Rainbow Measurement Setup::Main Functions::One Time Calibrations::MSpot Spectrum::MSpot Calibration Operation Translator.gvi
  Rainbow Measurement Setup::Side Functions::Sample Naming::Sample Name Checkup Subroutine.gvi
  Rainbow Measurement Setup::Side Functions::Sample Naming::Sample Prefix FGV.gvi
  Rainbow Measurement Setup::Main Functions::Rainbow Measurement::Light Power Calibration::Light Power Calibration Operation Translator.gvi
  NI::G Core::Error::Multiplex Errors.gvi
  NI::G Core::Error::Display Error.gvi
diagram:
  call "FGV Global Abort.gvi"(Global Abort Instructions="Reset State") -> (Error Out=w1)
  call "FGV Current State.gvi"(Current State Instructions="Set Current State and Substate", Current State="Undefined State", Current Substate="Starting Up", Error In=w1) -> (Error Out=w2)
  Obtain Queue(create if not found=TRUE, element data type="Queue Instructions Control.gtype" "Undefined State", error in=w2, name="Instruction Queue") -> (error out=w3, queue out=w4)
  Enqueue Element(element="Debug Check", error in=w3, queue=w4) -> (error out=w5, queue out=w6)
  s1 = w6  # shift register
  s2 = w5  # shift register
  while {
    # This is the consumer loop, it takes enqueued instructions and performs the ne required actions
    case (s2) {
      frame Error, Default {
        w7 = s2
        w8 = s1
        w9 = TRUE
      }
      frame No Error {
        Dequeue Element(error in=s2, queue=s1) -> (element=w10, error out=w11, queue out=w12)
        case (w10) {
          frame "Undefined State" {
            w7 = w11
            w8 = w12
            w9 = default
          }
          frame "Debug Check" {
            call "Debugging Prompt.gvi"(Debugging Cluster In=$"Debugging Cluster", Error In=w11) -> (Debugging Cluster Out=w13, Error Out=w14)
            Enqueue Element(element="Initialize App", error in=w14, queue=w12) -> (error out=w7, queue out=w8)
            $"Debugging Cluster" <- w13
            w9 = default
          }
          frame "Initialize App" {
            $"Label Info Missing Error" <- TRUE
            call "Initialize app subroutine.gvi"(Initialize App Bundle Cluster In=$"Initialize App Bundle Cluster", Debugging Cluster In=$"Debugging Cluster", Error In=w11) -> (Initialize App Bundle Cluster Out=w15, Debugging Cluster Out=w16, Error Out=w17)
            $"Initialize App Bundle Cluster" <- w15
            Property Node(instance in=w15) -> ("Instrument Coms Info"=w18)
            $"Instrument Coms Info" <- w18
            Enqueue Element(element="Idle", error in=w17, queue=w12) -> (error out=w7, queue out=w8)
            $"Debugging Cluster" <- w16
            w9 = default
          }
          frame "Idle", Default {
            call "FGV Global Abort.gvi"(Global Abort Instructions="Reset State", Error In=w11) -> (Error Out=w19)
            call "FGV Current State.gvi"(Current State Instructions="Set Current State and Substate", Current State="Idle", Current Substate="Idle", Error In=w19) -> (Error Out=w20)
            call "Progress FGV.gvi"(FGV Instructions="Reset State", Error In=w20) -> (Error Out=w7)
            w8 = w12
            w9 = default
          }
          frame "MSpot Spectrum Calibration" {
            call "MSpot Folder Check.gvi"(Error In=w11) -> (Error Out=w21, Calibration Files Folder=w22)
            $"Path Where the Calibration Files Will Be Stored (Can't Be Changed)" <- w22
            call "MSpot Spectrum Calibration Subroutine.gvi"(Instrument Coms Info In=$"Instrument Coms Info", Rainbow Sweep Param Selector=$"Rainbow Sweep Param Selector", MSpot Spectrum Calibration Parameters=$"Measuring Spot Sperctrum Calibration Parameters", Debugging Cluster In=$"Debugging Cluster", Error In=w21, Stand Alone?=FALSE, Calibration Operation Control=$"Desired MSpot Calibration Operation") -> (Instrument Coms Info Out=w23, Debugging Cluster Out=w24, Error Out=w25)
            $"Instrument Coms Info" <- w23
            $"Debugging Cluster" <- w24
            Enqueue Element(element="Idle", error in=w25, queue=w12) -> (error out=w7, queue out=w8)
            w9 = default
          }
          frame "Light Power Calibration" {
            call "Light Power Calibration Subroutine.gvi"(Light Power Operation Control=$"Light Power Operation Control", Instrument Coms Info In=$"Instrument Coms Info", Debugging Cluster In=$"Debugging Cluster", Rainbow Sweep Param Selector=$"Rainbow Sweep Parameters LPC", Light Power Calibration Data In=$"Light Power Calibration Data", Cell Naming Cluster=$"Cell Naming Cluster", Error In=w11, Default Data Saving Location=$"Default Data Saving Location", Stand Alone?=FALSE) -> (Instuments Coms Info Out=w26, Debugging Cluster Out=w27, Light Power Calibration Data Out=w28, Error Out=w29)
            $"Instrument Coms Info" <- w26
            $"Debugging Cluster" <- w27
            Enqueue Element(element="Idle", error in=w29, queue=w12) -> (error out=w7, queue out=w8)
            $"Light Power Calibration Data" <- w28
            w9 = default
          }
          frame "Stop App" {
            call "FGV Current State.gvi"(Current State Instructions="Set Current State and Substate", Current State="Stop App", Current Substate="Bye Bye :D", Error In=w11) -> (Error Out=w7)
            w8 = w12
            w9 = TRUE
          }
        }
      }
    }
    call "Is Error.gvi"(error in=w7) -> (error?=w30)
    Logical Or(w30, w9) -> w31
    call "FGV Global Abort.gvi"(Global Abort Instructions="Set State", Global Abort=w31, Error In=w7) -> (Error Out=w32)
    next s1 = w8
    next s2 = w32
    stop if w31
  }
  # This is the main window it takes instructions from the main pannel introduced by the user and
  # performs the corresponding necessary actions
  s3 = w6  # shift register
  s4 = w5  # shift register
  while {
    # This is the producer loop that takes the commands and if possible enqueues them so that the
    # slave loop can perform the corresponding actions
    event (timeout = 100) {
      on "Timeout" {
        call "Light Calibration Live Parameters FGV.gvi"(FGV Instructions="Read State", Error In=s4) -> (Light Calibration Parameters Out=w36, Light Power Calibration Graph Out=w37, Error Out=w38)
        $"Sweep Live Parameters LPC" <- w36
        call "Progress FGV.gvi"(FGV Instructions="Read State", Error In=w38) -> (Progress Out=w39, Error Out=w40)
        call "Timeout Sequence.gvi"(Queue In=s3, Error In=w40) -> (Stop App?=w35, Queue Out=w33, Current State Out=w41, Current SubState Out=w42, Error Out=w43)
        $"Current State" <- w41
        $Substate <- w42
        $"Progress %" <- w39
        $"Current Sub State" <- w42
        $"Progress counter" <- w39
        Format Into String(errIn=w43, w41) -> (outString=w44, errOut=w34)
        $State <- w44
        $"Light Power Calibration" <- w37
      }
      on "Exit App Button" Value changed {
        call "Exit App Sequence.gvi"(Queue In=s3, Exit App=$"Exit App Button", Error In=s4) -> (Queue Out=w33, Error Out=w34)
        w35 = default
      }
      on "Abort Button" Value changed {
        call "Global Abort Sequence.gvi"(Queue In=s3, Global Abort=$"Abort Button", Error In=s4) -> (Queue Out=w33, Error Out=w34)
        w35 = default
      }
      on "Check Dividing Wavelength Calibration" Value changed; "Load Dividing Wavelength Calibration" Value changed; "New Dividing Wavelength Calibration" Value changed {
        call "Check Queue And Label.gvi"(Error In=s4) -> (Proceed to enqueue=w45, Error Out=w46)
        call "Conditional Enqueue.gvi"(Queue In=s3, Queue Instruction In="MSpot Spectrum Calibration", Error Out=w46, Equeue?=w45) -> (Queue Out=w33, Error In=w47)
        call "MSpot Calibration Operation Translator.gvi"(Check Dividing Wavelength Calibration=$"Check Dividing Wavelength Calibration", New Dividing Wavelength Calibration=$"New Dividing Wavelength Calibration", Load Dividing Wavelength Calibration=$"Load Dividing Wavelength Calibration", Error In=w47) -> (Desired Operation=w48, Error Out=w34)
        $"Desired MSpot Calibration Operation" <- w48
        w35 = default
      }
      on "Author Initials" Value changed; "Batch Name" Value changed; "Cell Number" Value changed; "Current Date" Value changed; "Custom date" Value changed; "Main Tab" Value changed; "Rainbow Measurement tab" Value changed; "Sample Comments" Value changed; "Sample Prefix" Value changed {
        Property Node(instance in="Sample Naming Cluster.gtype" {all zero or empty}, "Author Initials"=$"Author Initials", "Batch Name"=$"Batch Name", "Sample Comments"=$"Sample Comments", "Main Tab control"=$"Main Tab", "Rainbow Measurement tab"=$"Rainbow Measurement tab", "Cell Number"=$"Cell Number", "Cell Number ref"=reference to "Cell Number", "Custom date"=$"Custom date", "Current Date"=$"Current Date", "Current Date ref"=reference to "Current Date") -> (instance out=w49)
        call "Sample Name Checkup Subroutine.gvi"(Sample Naming Cluster=w49, Error In=s4) -> (Current Date=w50, Sample Prefix=w51, Label Info Error Label=w52, Label Info Missing Error=w53, Error Out=w54, Cell Naming Cluster=w55)
        $"Cell Naming Cluster" <- w55
        $"Sample Prefix" <- w51
        $"Label Info Error Label" <- w52
        call "Sample Prefix FGV.gvi"(FGV Instructions="Set State", Sample Prefix In=w51, Error In=w54) -> (Error Out=w34)
        $"Label Info Missing Error" <- w53
        $"Current Date" <- w50
        w33 = s3
        w35 = default
      }
      on "Load Light Power Calibration" Value changed; "New Light Power Calibration" Value changed; "Save Light Power Calibration" Value changed {
        call "Check Queue And Label.gvi"(Label Info Missing Error=$"Label Info Missing Error", Label Info Error Label=$"Label Info Error Label", Error In=s4, Is Label Necessary?=TRUE) -> (Proceed to enqueue=w56, Error Out=w57)
        call "Conditional Enqueue.gvi"(Queue In=s3, Queue Instruction In="Light Power Calibration", Error Out=w57, Equeue?=w56) -> (Queue Out=w33, Error In=w58)
        call "Light Power Calibration Operation Translator.gvi"(New Light Power Calibration=$"New Light Power Calibration", Load Light Power Calibration=$"Load Light Power Calibration", Save Light Power Calibration=$"Save Light Power Calibration", Error In=w58) -> (Light Power Operation Control=w59, Error Out=w34)
        $"Light Power Operation Control" <- w59
        w35 = default
      }
    }
    Logical Or(w34, w35) -> w60
    next s3 = w33
    next s4 = w34
    stop if w60
  }
  Enqueue Element(element="Stop App", error in=s4, queue=s3) -> (error out=w61)
  call "Multiplex Errors.gvi"(error in 1=w61, error in 2=s2) -> (error out=w62)
  Flush Queue(error in=w62, queue=s1) -> (error out=w63, queue out=w64)
  Release Queue(error in=w63, queue=w64) -> (error out=w65)
  case (w65) {
    frame Error, Default {
      # In case there is an error
      # put out an error handler
      call "Display Error.gvi"(error in=w65)
    }
    frame No Error { }
  }
